# Grasshopper definition Spiral01.gh (Grasshopper 1.0.7)
# plug-ins: MeshEdit Components

spirals = GetNumber(Slider(10, range=0..10), AtLeast=1, AtMost=1, Maximum=1.797693135e+308, Minimum=-1.797693135e+308, TreeAccess=False)
height = GetNumber(Slider(10, range=0..10), AtLeast=1, AtMost=1, Maximum=1.797693135e+308, Minimum=-1.797693135e+308, TreeAccess=False)
pi = Pi(Factor=spirals)
number_slider = Slider(15, range=0..100)
number_slider_2 = Slider(58, range=0..100)
range = Range(Domain=pi, Steps=number_slider_2)
multiplication = Multiplication(A=range, B=height)
expression = Expression(A=number_slider, t=range, Expression="A*t*cos(t)")
expression_2 = Expression(A=number_slider, t=range, Expression="A*t*sin(t)")
pt = ConstructPoint(XCoordinate=expression_2, YCoordinate=expression, ZCoordinate=multiplication)
expression_3 = Expression(u=number_slider_2, Expression="U+1")
intcrv = Interpolate(Vertices=pt, Degree=3, Periodic=False, KnotStyle=1)  # -> Curve, Length, Domain
crv_cp = CurveClosestPoint(Point=pt, Curve=intcrv.Curve)  # -> Point, Parameter, Distance
eval = EvaluateCurve(Curve=intcrv.Curve, Parameter=crv_cp.Parameter)  # -> Point, Tangent, Angle
pframe = PerpFrame(Curve=intcrv.Curve, Parameter=crv_cp.Parameter)
Z = UnitZ(Factor=1)
vrot = Rotate(Vector=eval.Tangent, Axis=Z, Angle=1.570796327)
number_slider_3 = Slider(20, range=0..100)
multiplication_2 = Multiplication(A=vrot, B=Slider(83, range=0..100))
arrlinear = LinearArray(Geometry=eval.Point, Direction=vrot, Count=number_slider_3)  # -> Geometry, Transform
frompoints = MeshFromPoints(Points=flatten(arrlinear.Geometry), UDirection=expression_3, VDirection=number_slider_3)
context_bake = ContextBake(Geometry=frompoints)
